# Grasshopper definition typo2.4.gh (Grasshopper 1.0.8)

curve = Curve(<curve referenced from the Rhino model>)
number_slider = Slider(35, range=0..100)
curve_2 = Curve(<curve referenced from the Rhino model>)
curve_3 = Curve(<curve referenced from the Rhino model>)
domain_box = DomainBox(Base=PlaneXY(0, 0, 0), X=number_slider, Y=number_slider, Z=number_slider)
random = Random(Range="15 to 30", Number=1, Seed=2)
boundary_surfaces = BoundarySurfaces(Edges=curve_2)
unit_z = UnitZ(Factor=random)
number_slider_2 = Slider(180, range=0..1000)
extrude = Extrude(Base=boundary_surfaces, Direction=unit_z)
random_2 = Random(Range="0.8 to 1.2", Number=number_slider_2, Seed=2)
area = Area(Geometry=extrude)  # -> Area, Centroid
populate_3d = Populate3D(Region=domain_box, Count=Slider(180, range=0..1000), Seed=1)
random_3 = Random(Range="0 to 360", Number=number_slider_2, Seed=2)
cap_holes = CapHoles(Brep=extrude)
scale = Scale(Geometry=cap_holes, Center=area.Centroid, Factor=random_2)  # -> Geometry, Transform
rotate_3d = Rotate3D(Geometry=scale.Geometry, Angle=random_3, Center=area.Centroid, Axis=Vector(0, 0, 1))  # -> Geometry, Transform
move = Move(Geometry=rotate_3d.Geometry, Motion=populate_3d)  # -> Geometry, Transform
solid_union = SolidUnion(Breps=move.Geometry)
number_slider_3 = Slider(4.4, range=0..10)
vector_xyz = VectorXYZ(XComponent=Slider(500, range=0..1000), YComponent=0, ZComponent=0)  # -> Vector, Length
number_slider_4 = Slider(65, range=0..1000)
xy_plane = XYPlane(Origin=vector_xyz.Vector)
surface = Surface(<surface referenced from the Rhino model>)
unit_x = UnitX(Factor=Slider(7, range=0..10))
series = Series(Start=Slider(1, range=0..1), Step=1, Count=Slider(15, range=0..100))
shortest_list = ShortestList(TrimMode=2)  # -> ListListA, ListListB

brep = Brep(solid_union)
contour = Contour(Point=Point(0, 0, 0), Direction=Vector(0, 0, 1))
rectangle = Rectangle(Plane=xy_plane, XSize=number_slider_4, YSize=number_slider_4, Radius=0)  # -> Rectangle, Length
rectangular_array = RectangularArray(Geometry=rectangle.Rectangle, Cell=rectangle.Rectangle, XCount=Slider(2, range=0..10), YCount=Slider(8, range=0..10))  # -> Geometry, Transform
area_2 = Area(Geometry=rectangular_array.Geometry)  # -> Area, Centroid

bounding_box = BoundingBox(Content=brep, Plane=PlaneXY(0, 0, 0))  # -> Box, Box_2
area_3 = Area(Geometry=brep)  # -> Area, Centroid
deconstruct_box = DeconstructBox(Box=bounding_box.Box)  # -> Plane, X, Y, Z
bounds = Bounds(Numbers=deconstruct_box.Z)
deconstruct_domain = DeconstructDomain(Domain=deconstruct_box.Z)  # -> Start, End
deconstruct_domain_2 = DeconstructDomain(Domain=bounds)  # -> Start, End
division = Division(A=deconstruct_domain_2.End, B=number_slider_3)
integer = Integer(division)
panel = Panel(integer)
unit_z_2 = UnitZ(Factor=deconstruct_domain.Start)
series_2 = Series(Start=0, Step=number_slider_3, Count=integer)
unit_z_3 = UnitZ(Factor=series_2)
move_2 = Move(Geometry=surface, Motion=unit_z_2)  # -> Geometry, Transform
move_3 = Move(Geometry=move_2.Geometry, Motion=unit_z_3)  # -> Geometry, Transform
brep_plane = BrepPlane(Brep=brep, Plane=move_3.Geometry)  # -> Curves, Points
panel_2 = Panel(brep_plane.Curves)
flatten_tree = FlattenTree(Tree=brep_plane.Curves, Path="{0}")
length = Length(Curve=brep_plane.Curves)
panel_3 = Panel(length)
sort_list = SortList(Keys=length, ValuesValuesA=brep_plane.Curves)  # -> Keys, ValuesValuesA
bounds_2 = Bounds(Numbers=length)
sort_list_2 = SortList(Keys=sort_list.Keys, ValuesValuesA=sort_list.ValuesValuesA)  # -> Keys, ValuesValuesA
panel_4 = Panel(bounds_2)
deconstruct_domain_3 = DeconstructDomain(Domain=bounds_2)  # -> Start, End
panel_5 = Panel(sort_list_2.Keys)
flatten_tree_2 = FlattenTree(Tree=length, Path="{0}")
maximum = Maximum(A=deconstruct_domain_3.Start, B=deconstruct_domain_3.End)
member_index = MemberIndex(Set=flatten_tree_2, Member=maximum)  # -> Index, Count
list_item = ListItem(List=flatten_tree, Index=member_index.Index, Wrap=True)
panel_6 = Panel(maximum)

move_to_plane = MoveToPlane(Geometry=list_item, Plane=PlaneXY(0, 0, 0), Above=True, Below=True)  # -> flatten(Geometry), Transform
area_4 = Area(Geometry=move_to_plane.Geometry)  # -> Area, Centroid

shortest_list_2 = ShortestList(ListA=area_4.Centroid, ListB=area_2.Centroid, TrimMode=2)  # -> ListA, ListB

orient = Orient(Geometry=move_to_plane.Geometry, Source=shortest_list_2.ListA, Target=shortest_list_2.ListB)  # -> Geometry, Transform

area_5 = Area(Geometry=orient.Geometry)  # -> Area, Centroid
move_4 = Move(Geometry=area_5.Centroid, Motion=unit_x)  # -> Geometry, Transform
surface_2 = Surface(orient.Geometry)
line = Line(StartPoint=move_4.Geometry, EndPoint=area_5.Centroid)
text_on_surface = TextOnSurface(
    Text=series,
    Font="Sans Bold:no Italic:no",
    Height=Slider(8, range=0..10),
    Depth=0.4,
    BaseLine=line,
    BaseSurface=surface_2)
