# Grasshopper definition L3.12.gh (Grasshopper 1.0.8)
# plug-ins: RhinoCodePluginGH, PTComponentLibrary, Pancake

deconstruct_domain = DeconstructDomain()  # -> Start, End
number_slider = Slider(0.48, range=0..1)
subtraction = Subtraction(A=deconstruct_domain.End, B=deconstruct_domain.Start)
division = Division(A=subtraction, B=number_slider)
number_slider_2 = Slider(0.48, range=0..1)
number_slider_3 = Slider(0.48, range=0..1)
integer = Integer(division)
panel = Panel(integer)
series = Series(Start=Slider(1, range=0..100), Step=Slider(1, range=0..1), Count=Slider(41, range=0..100))
series_2 = Series(Start=deconstruct_domain.Start, Step=number_slider, Count=integer)
series_3 = Series(Start=Slider(1, range=0..100), Step=Slider(1, range=0..1), Count=Slider(41, range=0..100))
expression = Expression(r=Slider(10, range=0..10), e=number_slider_2, n=series, Expression="sqrt(r²-(r-e*n)²)")
expression_2 = Expression(r=Slider(10, range=0..10), e=number_slider_3, n=series_3, Expression="sqrt(r²-(r-e*n)²)")
expression_3 = Expression(e=number_slider_2, n=series, Expression="e*n")
expression_4 = Expression(e=number_slider_3, n=series_3, Expression="e*n")
addition = Addition(A=Slider(105, range=0..1000), B=expression)
subtraction_2 = Subtraction(A=Slider(105, range=0..1000), B=expression_2)
addition_2 = Addition(A=expression_3, B=Slider(95, range=0..100))
panel_2 = Panel(addition)
addition_3 = Addition(A=expression_4, B=Slider(95, range=0..100))
vector_xyz = VectorXYZ(XComponent=addition_2, YComponent=addition, ZComponent=0)  # -> Vector, Length
point = Point(vector_xyz.Vector)
vector_xyz_2 = VectorXYZ(XComponent=addition_3, YComponent=subtraction_2, ZComponent=0)  # -> Vector, Length
point_2 = Point(vector_xyz_2.Vector)
line = Line(StartPoint=point, EndPoint=point_2)
number_slider_4 = Slider(0.1, range=0..0.1)
relay = Relay()
number_slider_5 = Slider(0.01, range=0..0.01)
divide_distance = DivideDistance(Curve=flatten(relay), Distance=number_slider_4, AddEnd=True)
divide_distance_2 = DivideDistance(Curve=flatten(line), Distance=number_slider_4, AddEnd=True)
polyline = PolyLine(Vertices=divide_distance, Closed=False)
simplify_curve = SimplifyCurve(Curve=polyline, Tolerance=number_slider_5)  # -> Curve, Simplified
polyline_2 = PolyLine(Vertices=divide_distance_2, Closed=False)
simplify_curve_2 = SimplifyCurve(Curve=polyline_2, Tolerance=number_slider_5)  # -> Curve, Simplified
explode = Explode(Curve=[simplify_curve_2.Curve, polyline_2], Recursive=True)  # -> Segments, Vertices
explode_2 = Explode(Curve=simplify_curve.Curve, Recursive=True)  # -> Segments, Vertices
line_2 = Line(explode_2.Segments)

vector_xyz_3 = VectorXYZ(XComponent=0, YComponent=0, ZComponent=Slider(0.3, range=0..1))  # -> Vector, Length
branch = Panel("{0;1}")

# ---- group: A second line for testing
# [TODO]: Use lines for testing gcode generation then replace with line segments from slicing
number_slider_6 = Slider(1, range=-10..30)
construct_point = ConstructPoint(XCoordinate=Slider(10, range=-10..30), YCoordinate=Slider(10, range=-10..30), ZCoordinate=Slider(1, range=-10..30))
construct_point_2 = ConstructPoint(XCoordinate=Slider(10, range=-10..30), YCoordinate=Slider(20, range=-10..30), ZCoordinate=number_slider_6)
line_3 = Line(StartPoint=construct_point, EndPoint=construct_point_2)

# ---- group: Example of a line for testing
construct_point_3 = ConstructPoint(XCoordinate=Slider(5, range=-10..30), YCoordinate=Slider(1, range=-10..30), ZCoordinate=Slider(0, range=-10..30))
construct_point_4 = ConstructPoint(XCoordinate=Slider(30, range=-10..30), YCoordinate=Slider(1, range=-10..30), ZCoordinate=Slider(0, range=-10..30))
line_4 = Line(StartPoint=construct_point_3, EndPoint=construct_point_4)

# ----
# NOTE THAT THIS GCODE OUTPUT ASSUMES:
# - A PRUSA MK3S+ as the Printer
# - PLA Material
# - Extrusion Temperature: 215C
# - Heated Bed Temperature: 60C
end_gcode_do_not_edit = Panel("""; ##### WARNING: DO NOT EDIT THE END GCODE! ######
; END Gcode 
M204 S1000 
M107 
;TYPE:Custom 
; Filament-specific end gcode 
G1 Z180 F720 ; Move print head further up 
G1 X0 Y200 F3600 ; park 
M73 P97 R0
M73 Q97 S0
G4 ; wait
M221 S100 ; reset flow
M900 K0 ; reset LA
M104 S0 ; turn off temperature
M140 S0 ; turn off heatbed
M107 ; turn off fan
M84 ; disable motors
M73 P100 R0 ; print progress done
M73 Q100 S0 ; print progress done""")
start_gcode_do_not_edit = Panel("""; #### WARNING: DO NOT EDIT THE START GCODE! #####
;START GCODE
M73 P0 R2; Initial progress
M73 Q0 S2; Initial progress
M201 X1000 Y1000 Z200 E5000 ; sets maximum accelerations mm/sec^2
M203 X200 Y200 Z12 E120 ; sets maximum feedrates mm / sec
M204 S1250 T1250 ; sets acceleration (S) and retract acceleration (R) mm/sec^2
M205 X8.00 Y8.00 Z0.40 E4.50 ; sets the jerk limits mm/sec
M205 S0 T0 ; sets the minimum extruding and travel feed rate mm/sec
;TYPE: "Custom" v20250307a
M862.3 P "MK3S" ; printer model check
M862.1 P0.4 ; nozzle diameter check
M115 U3.14.0 ; tell printer latest fw version
G90 ; use absolute coordinates
M83 ; extruder relative mode
M104 S215 ; set extruder temp
M140 S60 ; set bed temp
M190 S60 ; wait for bed temp
M109 S215 ; wait for extruder temp
G28 W ; home all without mesh bed level
G80 X112.257 Y92.2571 W25.4859 H25.4859 ; mesh bed levelling
G1 Z0.2 F720
G1 Y-3 F1000 ; go outside print area
G92 E0
G1 X60 E9 F1000 ; intro line
G1 X100 E12.5 F1000 ; intro line
M73 P2 R2 ; progress
M73 Q2 S2 ; progress
G92 E0
M221 S95
; Don't change E values below. Excessive value can damage the printer.
M907 E538 ; set extruder motor current
G21 ; set units to millimeters
G90 ; use absolute coordinates
M83 ; use relative distances for extrusion
M900 K0.05 ; Filament gcode LA 1.5
M900 K30 ; Filament gcode LA 1.0
M107""")
travel_feed_rate = Panel("1200")
true_only_button = TrueOnlyButton(LastSaveLocalization="neutral,N")
# [TODO]: Use Pancake Plug-in to Export Gcode Output File as .gcode
panel_3 = Panel("/Users/kunsting/Downloads/YK13.gcode")

# ---- group: Base Shape
height = Slider(0.3, range=0..1)
height_2 = Slider(1.5, range=0..10)
radius = Slider(10, range=0..10)
number_slider_7 = Slider(105, range=0..1000)
location = ConstructPoint(XCoordinate=number_slider_7, YCoordinate=number_slider_7, ZCoordinate=0)

# ----
unit_z = UnitZ(Factor=height_2)
circle = Circle(Plane=PlaneXY(0, 0, 0), Radius=radius)
extrude = Extrude(Base=circle, Direction=unit_z)

# ---- group: Base Shape (continued)
cap_holes = CapHoles(Brep=extrude)
move = Move(Geometry=cap_holes, Motion=location)  # -> Geometry, Transform

# ----
bounding_box = BoundingBox(Content=move.Geometry, Plane=PlaneXY(0, 0, 0))  # -> Box, Box_2
deconstruct_box = DeconstructBox(Box=bounding_box.Box)  # -> Plane, X, Y, Z
deconstruct_domain_2 = DeconstructDomain(Domain=deconstruct_box.Z)  # -> Start, End
contour_ex = ContourEx(Shape=move.Geometry, Plane=PlaneXY(0, 0, 0), Offsets=vector_xyz_3.Vector)

# ---- group: Outlines
material = Slider(0.3, range=0..1)
contour = Contour(Shape=move.Geometry, Point=Point(0, 0, 0), Direction=Vector(0, 0, 1), Distance=material)

# ----
addition_4 = Addition(A=deconstruct_domain_2.Start, B=material)
cull_index = CullIndex(List=flatten(contour), Indices="0", Wrap=True)  # -> graft(List)

# ---- group: Outlines (continued)
boundary_surfaces = BoundarySurfaces(Edges=cull_index)

# ---- group: Deconstruct the infill area
deconstruct_box_2 = DeconstructBox(Box=boundary_surfaces)  # -> Plane, X, Y, Z
deconstruct_domain_3 = DeconstructDomain(Domain=deconstruct_box_2.Y)  # -> Start, End
deconstruct_domain_4 = DeconstructDomain(Domain=deconstruct_box_2.Z)  # -> Start, End
deconstruct_domain_5 = DeconstructDomain(Domain=deconstruct_box_2.X)  # -> Start, End
vector_xyz_4 = VectorXYZ(XComponent=0, YComponent=0, ZComponent=deconstruct_domain_4.Start)  # -> Vector, Length
vector_xyz_5 = VectorXYZ(XComponent=deconstruct_domain_5.Start, YComponent=deconstruct_domain_3.End, ZComponent=vector_xyz_4.Vector)  # -> Vector, Length
vector_xyz_6 = VectorXYZ(XComponent=deconstruct_domain_5.Start, YComponent=deconstruct_domain_3.Start, ZComponent=vector_xyz_4.Vector)  # -> Vector, Length

# ---- group: Infill calculation
list_item = ListItem(List=flatten(deconstruct_box_2.X), Index=Slider(1, range=0..1), Wrap=True)
bounds = Bounds(Numbers=list_item)
deconstruct_domain_6 = DeconstructDomain(Domain=bounds)  # -> Start, End
ew = Slider(0.48, range=0..1)
division_2 = Division(A=deconstruct_domain_6.End, B=ew)
infill_calculation = Integer(division_2)

# ---- group: Infill lines
line_5 = Line(StartPoint=vector_xyz_5.Vector, EndPoint=vector_xyz_6.Vector)
addition_5 = Addition(A=infill_calculation)
series_4 = Series(Start=Slider(0, range=0..1), Step=Slider(0.48, range=0..1), Count=addition_5)
unit_x = UnitX(Factor=series_4)
move_2 = Move(Geometry=line_5, Motion=unit_x)  # -> Geometry, Transform
brep_line = BrepLine(Brep=boundary_surfaces, Line=move_2.Geometry, LimitToFirst=False, UseTasks=True)  # -> Curves, Points

# ---- group: Tree Structure
graft_tree = GraftTree(Tree=cull_index, IncludeEmptyLists=True, IncludeNullItems=True)
merge = Merge(Data1=brep_line.Curves, Data2=graft_tree)
trim_tree = TrimTree(Tree=merge, Depth=Slider(1, range=0..10))
clean_tree = CleanTree(RemoveNulls=True, RemoveInvalid=True, RemoveEmpty=False, Tree=trim_tree)
simplify_tree = SimplifyTree(Tree=clean_tree, Front=False)

# ----
panel_4 = Panel(graft_tree)
param_viewer = ParamViewer(merge)
panel_5 = Panel(brep_line.Curves)
panel_6 = Panel(trim_tree)
testing = Panel(simplify_tree)

# ---- group: Reconstructing lines
divide_distance_3 = DivideDistance(Curve=simplify_tree, Distance=Slider(0.1, range=0..0.1))  # -> Points, Tangents, Parameters
polyline_3 = PolyLine(Vertices=divide_distance_3.Points, Closed=True)
tolerance = Slider(0.01, range=0..0.01)
simplify_curve_3 = SimplifyCurve(Curve=polyline_3, Tolerance=tolerance)  # -> Curve, Simplified
panel_7 = Panel(polyline_3)
# [TODO]: Create Line Segments from Perimeters and Infill
explode_3 = Explode(Curve=simplify_curve_3.Curve, Recursive=True)  # -> Segments, Vertices
panel_8 = Panel(explode_3.Segments)

# ----
panel_9 = Panel(simplify_curve_3.Curve)
# [TODO]: Initialize Input Parameters
line_6 = Line(explode_3.Segments)
line_7 = Line(line_6)
# [TODO]: Implement the gcode generation algorithm in Python
python_3_script_generate_gcode = Python3Script(
    lines=flatten(line_7),
    nozzle_diameter=Slider(0.4, range=0..1),
    filament_diameter=Slider(1.75, range=0..10),
    layer_height=Slider(0.3, range=0..1),
    extrusion_width=Slider(0.48, range=0..1),
    travel_feed_rate=travel_feed_rate,
    layer_change_feed_rate=Slider(720, range=0..1000),
    extrusion_feed_rate=Slider(600, range=0..1000),
    start_gcode_lines=start_gcode_do_not_edit,
    end_gcode_lines=end_gcode_do_not_edit)  # -> out, gcode_output; inputs lines: list of Line, nozzle_diameter: Double, filament_diameter: Double, layer_height: Double, extrusion_width: Double, travel_feed_rate: Double, layer_change_feed_rate: Double, extrusion_feed_rate: Double, start_gcode_lines: list of String, end_gcode_lines: list of String
# ---------- python_3_script_generate_gcode: Python ----------
"""
    This file contains parameters, helpers, and setup to 
    create a basic gcode generation algorithm from line segments.
    
    The main 
    
    Inputs:
        lines: the line segments to be converted into gcode commands for extrusion 
        nozzle_diameter: the diameter of the 3D printer's nozzle
        filament_diameter: the diameter of the 3d printing filament
        layer_height: the height of each layer in the print
        extrusion_width: the width of the extruded line from the printer
        travel_feed_rate: the speed at which the extruder moves in X and Y
        layer_change_feed_rate: the speed at which teh extruder moves when 
            changing layers in the Z direction
        extrusion_feed_rate: the speed at which the extruder move when extruding

    Output:
        gcode_output: a string with gcode commands separate by new-lines"""

__author__ = "mrivera-cu"

import rhinoscriptsyntax as rs

import math


########## CONSTANTS BELOW ###############

# GCODE COMMANDS
COMMAND_MOVE = "G1"

# GCODE PARAM NAMES
PARAM_X = "X"
PARAM_Y = "Y"
PARAM_Z = "Z"
PARAM_E = "E"
PARAM_F = "F"

# Separates commands
COMMAND_DELIMITER = "\n"

# Precision for converting floats to strings
E_VALUE_PRECISION = 5
XYZ_VALUE_PRECISION = 3

# Float equality precision
FLOAT_EQUALITY_PRECISION = 5

# Converts a float (f) to a string with some precision of decimal places
# For example: 
# Input: f=0.1234, precision=3 
# Output: "0.123"
def float_to_string(f, precision=XYZ_VALUE_PRECISION): 
    f = float(f)
    str_format = "{value:." + str(precision) +"f}"
    return str_format.format(value=f)
    
# Helper to convert the E value to the proper precision
def e_value_to_string(e):
    return float_to_string(e, E_VALUE_PRECISION)

# Helper to convert the XYZ value to the proper precision
def xyz_value_to_string(e):
    return float_to_string(e, XYZ_VALUE_PRECISION)

#########################################################################

# Helper function to compare floats in grasshopper/python due to float precision errors
def are_floats_equal(f1, f2, epsilon=10**(-FLOAT_EQUALITY_PRECISION)):
    f1 *= 10**FLOAT_EQUALITY_PRECISION
    f2 *= 10**FLOAT_EQUALITY_PRECISION
    return math.fabs(f2 - f1) <= epsilon
    
# Helper function to compare if two points are equal (have the same coordinates)
# by handling float precision comparisons
def is_same_pt(ptA, ptB):
    return are_floats_equal(ptA[0], ptB[0]) and are_floats_equal(ptA[1], ptB[1]) and are_floats_equal(ptA[2], ptB[2])
     
     
########################################################################
# creates a string consisting of a G1 move command and 
# any associated parameters
def gcode_move(current_pos, next_pos, feed_rate=None, should_extrude=False):
    # Start with "G1" as command
    move_command_str = COMMAND_MOVE
    
    # Compare X positions
    if (not are_floats_equal(current_pos[0],next_pos[0])):
        # we have a different x position so add it as a parameter to the command
        x_value = float_to_string(next_pos[0], precision=XYZ_VALUE_PRECISION)
        # Add X<x_value> to move string, e.g., X100.00
        move_command_str += " " + PARAM_X + x_value
    
    # Compare Y positions
    if (not are_floats_equal(current_pos[1], next_pos[1])):
        # we have a different y position so add the new position as a parameter
        y_value = float_to_string(next_pos[1], precision=XYZ_VALUE_PRECISION)
        # Add Y<y_value> to move string, e.g., Y100.00
        move_command_str += " " + PARAM_Y + y_value
    
    # Compare Z position
    if (not are_floats_equal(current_pos[2], next_pos[2])):
        # we have a different z position so add the new position as a parameter
        z_value = float_to_string(next_pos[2], precision=XYZ_VALUE_PRECISION)
        # Add Z<z_value> to move string, e.g., Z100.00
        move_command_str += " " + PARAM_Z + z_value
    
    # [TODO]: handle "should_extrude" == true by determining the proper amount to
    # extrude using the capsule model, then append the E parameter and value
    # to the move command.
    # NOTE: YOUR FLOAT PRECISION MUST MATCH E_VALUE_PRECISION
    if should_extrude:
        dx = next_pos[0] - current_pos[0]
        dy = next_pos[1] - current_pos[1]
        dz = next_pos[2] - current_pos[2]
        distance = math.sqrt(dx**2 + dy**2 + dz**2)

        # Rectangular area + two half circles = rectangle + 1 full circle
        rect_area = (extrusion_width - layer_height) * layer_height
        semi_circle_area = math.pi * (layer_height / 2.0) ** 2
        extrusion_area = rect_area + semi_circle_area  # mm²

        # Output volume = cross-sectional area * distance moved
        v_out = extrusion_area * distance  # mm³

        # Filament cross-sectional area (input)
        filament_area = math.pi * (filament_diameter / 2.0) ** 2  # mm²

        # E value = volume of extrusion / filament cross-section area
        e_value = v_out / filament_area  # mm (filament length extruded)

        # Append E value to command
        move_command_str += " " + PARAM_E + e_value_to_string(e_value)
    
    # See if we have a feedrate to use, and handle it differently than other 
    # parameters as it is an integer value
    if (feed_rate is not None):
        # feed rate is an int
        feed_rate_value = round(feed_rate)
        # Add F<feed_rate_value> to move string, e.g., F2000
        move_command_str += " " + PARAM_F + str(feed_rate_value)   
    
    # Remove excess whitespace on ends
    move_command_str = move_command_str.strip(" ")
    return move_command_str



    
''' Here's the main method of the script that uses the helper methods above '''


def generate_gcode():
   

    #Initialize
    current_position = [0.0, 0.0, 0.0]
    all_move_commands = []
    last_layer_z = None

    # Loop over each line segment
    for line in lines:
        start_pt = [line.From.X, line.From.Y, line.From.Z]
        end_pt = [line.To.X, line.To.Y, line.To.Z]

        # Layer change - move Z only if necessary
        if last_layer_z is None or not are_floats_equal(last_layer_z, start_pt[2]):
            z_move_target = [current_position[0], current_position[1], start_pt[2]]
            z_move_command = gcode_move(
                current_pos=current_position,
                next_pos=z_move_target,
                feed_rate=layer_change_feed_rate,
                should_extrude=False
            )
            all_move_commands.append(z_move_command)
            current_position = z_move_target
            last_layer_z = start_pt[2]

        #Travel move to line start
        if not is_same_pt(current_position, start_pt):
            travel_command = gcode_move(
                current_pos=current_position,
                next_pos=start_pt,
                feed_rate=travel_feed_rate,
                should_extrude=False
            )
            all_move_commands.append(travel_command)
            current_position = start_pt

        # Extrude move along the line
        extrude_command = gcode_move(
            current_pos=current_position,
            next_pos=end_pt,
            feed_rate=extrusion_feed_rate,
            should_extrude=True
        )
        all_move_commands.append(extrude_command)
        current_position = end_pt

  
    gcode_lines = start_gcode_lines + all_move_commands + end_gcode_lines

    output = COMMAND_DELIMITER.join(gcode_lines)
    
    return output
    
''' RUN THE MAIN FUNCITON ABOVE - DO NOT EDIT '''
# this sets the gcode commands to be the the gcode_output variable of this grasshopper component
gcode_output = generate_gcode()
# ---------- end python_3_script_generate_gcode ----------
debugging_panel = Panel(python_3_script_generate_gcode.out)
panel_10 = Panel(python_3_script_generate_gcode.gcode_output)
export_txt = ExportTXT(
    Content=panel_10,
    FileLocation=panel_3,
    Overwrite=Toggle(True),
    Encoding="utf-8",
    Export=true_only_button,
    LastSaveLocalization="neutral,N")
panel_11 = Panel(export_txt)
