# Grasshopper definition L3.extra.gh (Grasshopper 1.0.8)
# plug-ins: RhinoCodePluginGH, PTComponentLibrary, Pancake

deconstruct_domain = DeconstructDomain()  # -> Start, End
number_slider = Slider(0.48, range=0..1)
subtraction = Subtraction(A=deconstruct_domain.End, B=deconstruct_domain.Start)
division = Division(A=subtraction, B=number_slider)
number_slider_2 = Slider(0.48, range=0..1)
number_slider_3 = Slider(0.48, range=0..1)
integer = Integer(division)
panel = Panel(integer)
series = Series(Start=Slider(1, range=0..100), Step=Slider(1, range=0..1), Count=Slider(41, range=0..100))
series_2 = Series(Start=deconstruct_domain.Start, Step=number_slider, Count=integer)
series_3 = Series(Start=Slider(1, range=0..100), Step=Slider(1, range=0..1), Count=Slider(41, range=0..100))
expression = Expression(r=Slider(10, range=0..10), e=number_slider_2, n=series, Expression="sqrt(r²-(r-e*n)²)")
expression_2 = Expression(r=Slider(10, range=0..10), e=number_slider_3, n=series_3, Expression="sqrt(r²-(r-e*n)²)")
expression_3 = Expression(e=number_slider_2, n=series, Expression="e*n")
expression_4 = Expression(e=number_slider_3, n=series_3, Expression="e*n")
addition = Addition(A=Slider(105, range=0..1000), B=expression)
subtraction_2 = Subtraction(A=Slider(105, range=0..1000), B=expression_2)
addition_2 = Addition(A=expression_3, B=Slider(95, range=0..100))
panel_2 = Panel(addition)
addition_3 = Addition(A=expression_4, B=Slider(95, range=0..100))
vector_xyz = VectorXYZ(XComponent=addition_2, YComponent=addition, ZComponent=0)  # -> Vector, Length
point = Point(vector_xyz.Vector)
vector_xyz_2 = VectorXYZ(XComponent=addition_3, YComponent=subtraction_2, ZComponent=0)  # -> Vector, Length
point_2 = Point(vector_xyz_2.Vector)
line = Line(StartPoint=point, EndPoint=point_2)
number_slider_4 = Slider(0.1, range=0..0.1)
relay = Relay()
number_slider_5 = Slider(0.01, range=0..0.01)
divide_distance = DivideDistance(Curve=flatten(relay), Distance=number_slider_4, AddEnd=True)
divide_distance_2 = DivideDistance(Curve=flatten(line), Distance=number_slider_4, AddEnd=True)
polyline = PolyLine(Vertices=divide_distance, Closed=False)
simplify_curve = SimplifyCurve(Curve=polyline, Tolerance=number_slider_5)  # -> Curve, Simplified
polyline_2 = PolyLine(Vertices=divide_distance_2, Closed=False)
simplify_curve_2 = SimplifyCurve(Curve=polyline_2, Tolerance=number_slider_5)  # -> Curve, Simplified
explode = Explode(Curve=[simplify_curve_2.Curve, polyline_2], Recursive=True)  # -> Segments, Vertices
explode_2 = Explode(Curve=simplify_curve.Curve, Recursive=True)  # -> Segments, Vertices
line_2 = Line(explode_2.Segments)

cell_size = Slider(2, range=0..10)
number_slider_6 = Slider(2, range=0..10)
number_slider_7 = Slider(1.5, range=0..10)
grid_density = GridDensity(Di=1, Dj=1)
trim_tree = TrimTree(Depth=1)
number_slider_8 = Slider(3, range=0..10)
bounding_box = BoundingBox(Plane=PlaneXY(0, 0, 0))  # -> Box, Box_2
# NOTE THAT THIS GCODE OUTPUT ASSUMES:
# - A PRUSA MK3S+ as the Printer
# - PLA Material
# - Extrusion Temperature: 215C
# - Heated Bed Temperature: 60C
end_gcode_do_not_edit = Panel("""; ##### WARNING: DO NOT EDIT THE END GCODE! ######
; END Gcode 
M204 S1000 
M107 
;TYPE:Custom 
; Filament-specific end gcode 
G1 Z180 F720 ; Move print head further up 
G1 X0 Y200 F3600 ; park 
M73 P97 R0
M73 Q97 S0
G4 ; wait
M221 S100 ; reset flow
M900 K0 ; reset LA
M104 S0 ; turn off temperature
M140 S0 ; turn off heatbed
M107 ; turn off fan
M84 ; disable motors
M73 P100 R0 ; print progress done
M73 Q100 S0 ; print progress done""")
# [TODO]: Create Line Segments from Perimeters and Infill
number_slider_9 = Slider(600, range=0..1000)
start_gcode_do_not_edit = Panel("""; #### WARNING: DO NOT EDIT THE START GCODE! #####
;START GCODE
M73 P0 R2; Initial progress
M73 Q0 S2; Initial progress
M201 X1000 Y1000 Z200 E5000 ; sets maximum accelerations mm/sec^2
M203 X200 Y200 Z12 E120 ; sets maximum feedrates mm / sec
M204 S1250 T1250 ; sets acceleration (S) and retract acceleration (R) mm/sec^2
M205 X8.00 Y8.00 Z0.40 E4.50 ; sets the jerk limits mm/sec
M205 S0 T0 ; sets the minimum extruding and travel feed rate mm/sec
;TYPE: "Custom" v20250307a
M862.3 P "MK3S" ; printer model check
M862.1 P0.4 ; nozzle diameter check
M115 U3.14.0 ; tell printer latest fw version
G90 ; use absolute coordinates
M83 ; extruder relative mode
M104 S215 ; set extruder temp
M140 S60 ; set bed temp
M190 S60 ; wait for bed temp
M109 S215 ; wait for extruder temp
G28 W ; home all without mesh bed level
G80 X112.257 Y92.2571 W25.4859 H25.4859 ; mesh bed levelling
G1 Z0.2 F720
G1 Y-3 F1000 ; go outside print area
G92 E0
G1 X60 E9 F1000 ; intro line
G1 X100 E12.5 F1000 ; intro line
M73 P2 R2 ; progress
M73 Q2 S2 ; progress
G92 E0
M221 S95
; Don't change E values below. Excessive value can damage the printer.
M907 E538 ; set extruder motor current
G21 ; set units to millimeters
G90 ; use absolute coordinates
M83 ; use relative distances for extrusion
M900 K0.05 ; Filament gcode LA 1.5
M900 K30 ; Filament gcode LA 1.0
M107""")
travel_feed_rate = Panel("1200")
true_only_button = TrueOnlyButton(LastSaveLocalization="neutral,N")
# [TODO]: Use Pancake Plug-in to Export Gcode Output File as .gcode
panel_3 = Panel("/Users/kunsting/Downloads/YK13.gcode")

# ---- group: Base Shape
height = Slider(0.3, range=0..1)
height_2 = Slider(1.5, range=0..10)
radius = Slider(10, range=0..10)
number_slider_10 = Slider(105, range=0..1000)
location = ConstructPoint(XCoordinate=number_slider_10, YCoordinate=number_slider_10, ZCoordinate=0)

# ----
unit_z = UnitZ(Factor=height_2)
circle = Circle(Plane=PlaneXY(0, 0, 0), Radius=radius)
extrude = Extrude(Base=circle, Direction=unit_z)

# ---- group: Base Shape (continued)
cap_holes = CapHoles(Brep=extrude)
move = Move(Geometry=cap_holes, Motion=location)  # -> Geometry, Transform

# ----
bounding_box_2 = BoundingBox(Content=move.Geometry, Plane=PlaneXY(0, 0, 0))  # -> Box, Box_2
deconstruct_box = DeconstructBox(Box=bounding_box_2.Box)  # -> Plane, X, Y, Z
deconstruct_domain_2 = DeconstructDomain(Domain=deconstruct_box.X)  # -> Start, End
deconstruct_domain_3 = DeconstructDomain(Domain=deconstruct_box.Y)  # -> Start, End
subtraction_3 = Subtraction(A=deconstruct_domain_2.End, B=deconstruct_domain_2.Start)
subtraction_4 = Subtraction(A=deconstruct_domain_3.End, B=deconstruct_domain_3.Start)

# ---- group: Outlines
material = Slider(0.3, range=0..1)
contour = Contour(Shape=move.Geometry, Point=Point(0, 0, 0), Direction=Vector(0, 0, 1), Distance=material)

# ----
panel_4 = Panel(contour)
cull_index = CullIndex(List=flatten(contour), Indices="0", Wrap=True)  # -> graft(List)
polygon = Polygon(Plane=cull_index, Radius=cell_size, Segments=6, FilletRadius=0)  # -> Polygon, Length
area = Area(Geometry=polygon.Polygon)  # -> Area, Centroid
rotate = Rotate(Geometry=polygon.Polygon, Angle=1.570796327, Plane=area.Centroid)  # -> Geometry, Transform
simplify_tree = SimplifyTree(Tree=rotate.Geometry, Front=False)
bounding_box_3 = BoundingBox(Content=simplify_tree, Plane=PlaneXY(0, 0, 0))  # -> Box, Box_2
deconstruct_box_2 = DeconstructBox(Box=bounding_box_3.Box)  # -> Plane, X, Y, Z
deconstruct_box_3 = DeconstructBox(Box=bounding_box_3.Box)  # -> Plane, X, Y, Z
deconstruct_domain_4 = DeconstructDomain(Domain=deconstruct_box_3.Y)  # -> Start, End
deconstruct_domain_5 = DeconstructDomain(Domain=deconstruct_box_2.X)  # -> Start, End
subtraction_5 = Subtraction(A=deconstruct_domain_5.End, B=deconstruct_domain_5.Start)
subtraction_6 = Subtraction(A=deconstruct_domain_4.End, B=deconstruct_domain_4.Start)
multiplication = Multiplication(A=subtraction_5, B=Slider(1.5, range=0..10))
multiplication_2 = Multiplication(A=subtraction_5, B=Slider(1.5, range=0..10))
division_2 = Division(A=subtraction_6, B=Slider(4, range=0..10))
multiplication_3 = Multiplication(A=subtraction_6, B=Slider(0.75, range=0..1))
division_3 = Division(A=subtraction_3, B=multiplication)

# ---- group: Outlines (continued)
boundary_surfaces = BoundarySurfaces(Edges=cull_index)

# ---- group: Deconstruct the infill area
deconstruct_box_4 = DeconstructBox(Box=boundary_surfaces)  # -> Plane, X, Y, Z
deconstruct_domain_6 = DeconstructDomain(Domain=deconstruct_box_4.Y)  # -> Start, End
deconstruct_domain_7 = DeconstructDomain(Domain=deconstruct_box_4.Z)  # -> Start, End
deconstruct_domain_8 = DeconstructDomain(Domain=deconstruct_box_4.X)  # -> Start, End
vector_xyz_3 = VectorXYZ(XComponent=0, YComponent=0, ZComponent=deconstruct_domain_7.Start)  # -> Vector, Length
vector_xyz_4 = VectorXYZ(XComponent=deconstruct_domain_8.Start, YComponent=deconstruct_domain_6.End, ZComponent=vector_xyz_3.Vector)  # -> Vector, Length
vector_xyz_5 = VectorXYZ(XComponent=deconstruct_domain_8.Start, YComponent=deconstruct_domain_6.Start, ZComponent=vector_xyz_3.Vector)  # -> Vector, Length

# ----
division_4 = Division(A=subtraction_4, B=subtraction_6)
series_4 = Series(Start=0, Step=expr("1.5*x", subtraction_5), Count=expr("x+1", division_3))
unit_x = UnitX(Factor=series_4)
move_2 = Move(Geometry=simplify_tree, Motion=unit_x)  # -> Geometry, Transform
series_5 = Series(Start=0, Step=expr("0.5*x", subtraction_6), Count=expr("2*x", division_4))
panel_5 = Panel(division_4)
panel_6 = Panel(series_4)
simplify_tree_2 = SimplifyTree(Tree=series_5, Front=False)
simplify_tree_3 = SimplifyTree(Tree=move_2.Geometry, Front=False)  # -> flatten(Tree)
tree_branch = TreeBranch(Tree=simplify_tree_2, Path="{1}", MaintainPaths=True)
unit_y = UnitY(Factor=tree_branch)  # -> graft(UnitVector)
simplify_tree_4 = SimplifyTree(Tree=boundary_surfaces, Front=False)
panel_7 = Panel(simplify_tree_3)
move_3 = Move(Geometry=simplify_tree_3, Motion=unit_y)  # -> Geometry, Transform
path_mapper = PathMapper(move_3.Geometry, source="{A;B}", target="{B}")
panel_8 = Panel(move_3.Geometry)
tree_statistics = TreeStatistics(Tree=path_mapper)  # -> Paths, Length, Count
deconstruct_path = DeconstructPath(Branch=tree_statistics.Paths)
integer_2 = Integer(deconstruct_path)
expression_5 = Expression(x=integer_2, Expression="x%2=0")
dispatch = Dispatch(List=path_mapper, DispatchPattern=expression_5)  # -> ListA, ListB
clean_tree = CleanTree(RemoveNulls=True, RemoveInvalid=True, RemoveEmpty=True, Tree=dispatch.ListA)
clean_tree_2 = CleanTree(RemoveNulls=True, RemoveInvalid=True, RemoveEmpty=True, Tree=dispatch.ListB)
unit_x_2 = UnitX(Factor=expr("0.75*x", subtraction_5))  # -> flatten(UnitVector)
move_4 = Move(Geometry=clean_tree_2, Motion=unit_x_2)  # -> Geometry, Transform
panel_9 = Panel(move_4.Geometry)
merge = Merge(Data1=move_4.Geometry, Data2=clean_tree)
area_2 = Area(Geometry=flatten(merge))  # -> Area, Centroid
area_3 = Area(Geometry=cull_index)  # -> Area, Centroid
panel_10 = Panel(area_3.Centroid)
average = Average(Input=area_2.Centroid)
tree_branch_2 = TreeBranch(Tree=area_3.Centroid, Path="{0;0;0}", MaintainPaths=True)
deconstruct = Deconstruct(Point=average)  # -> XComponent, YComponent, ZComponent

# ---- group: Tree Structure
graft_tree = GraftTree(Tree=cull_index, IncludeEmptyLists=True, IncludeNullItems=True)
merge_2 = Merge(Data2=graft_tree)  # disabled
trim_tree_2 = TrimTree(Tree=merge_2, Depth=Slider(1, range=0..10))
clean_tree_3 = CleanTree(RemoveNulls=True, RemoveInvalid=True, RemoveEmpty=False, Tree=trim_tree_2)
simplify_tree_5 = SimplifyTree(Tree=clean_tree_3, Front=False)

# ----
deconstruct_2 = Deconstruct(Point=tree_branch_2)  # -> XComponent, YComponent, ZComponent
construct_point = ConstructPoint(XCoordinate=deconstruct.XComponent, YCoordinate=deconstruct.YComponent, ZCoordinate=0)
construct_point_2 = ConstructPoint(XCoordinate=deconstruct_2.XComponent, YCoordinate=deconstruct_2.YComponent, ZCoordinate=0)
vector_2pt = Vector2Pt(PointA=construct_point, PointB=construct_point_2, Unitize=False)  # -> Vector, Length
move_5 = Move(Geometry=merge, Motion=vector_2pt.Vector)  # -> Geometry, Transform
trim_with_region = TrimWithRegion(Curve=move_5.Geometry, Region=cull_index)  # -> Inside, Outside
curve = Curve(trim_with_region.Inside)
param_viewer = ParamViewer(merge_2)
clean_tree_4 = CleanTree(RemoveNulls=True, RemoveInvalid=True, RemoveEmpty=True, Tree=curve)
simplify_tree_6 = SimplifyTree(Tree=cull_index, Front=False)  # -> graft(Tree)
simplify_tree_7 = SimplifyTree(Tree=clean_tree_4, Front=False)
merge_3 = Merge(Data1=simplify_tree_7, Data2=simplify_tree_6)
trim_tree_3 = TrimTree(Tree=merge_3, Depth=1)
panel_11 = Panel(trim_tree_3)

# ---- group: Reconstructing lines
divide_distance_3 = DivideDistance(Curve=simplify_tree_5, Distance=Slider(0.1, range=0..0.1))  # -> Points, Tangents, Parameters
polyline_3 = PolyLine(Vertices=divide_distance_3.Points, Closed=True)
tolerance = Slider(0.01, range=0..0.01)
simplify_curve_3 = SimplifyCurve(Curve=polyline_3, Tolerance=tolerance)  # -> Curve, Simplified
panel_12 = Panel(polyline_3)
explode_3 = Explode(Curve=simplify_curve_3.Curve, Recursive=True)  # -> Segments, Vertices

divide_distance_4 = DivideDistance(Curve=trim_tree_3, Distance=Slider(0.1, range=0..0.1))  # -> Points, Tangents, Parameters
polyline_4 = PolyLine(Vertices=divide_distance_4.Points, Closed=True)
tolerance_2 = Slider(0.01, range=0..0.01)
simplify_curve_4 = SimplifyCurve(Curve=polyline_4, Tolerance=tolerance_2)  # -> Curve, Simplified
panel_13 = Panel(polyline_4)
explode_4 = Explode(Curve=simplify_curve_4.Curve, Recursive=True)  # -> Segments, Vertices

# ----
# [TODO]: Use lines for testing gcode generation then replace with line segments from slicing
# [TODO]: Initialize Input Parameters
line_3 = Line(explode_3.Segments)
line_4 = Line(line_3)
# [TODO]: Implement the gcode generation algorithm in Python
python_3_script_generate_gcode = Python3Script(
    lines=flatten(line_4),
    nozzle_diameter=Slider(0.4, range=0..1),
    filament_diameter=Slider(1.75, range=0..10),
    layer_height=Slider(0.3, range=0..1),
    extrusion_width=Slider(0.48, range=0..1),
    travel_feed_rate=travel_feed_rate,
    layer_change_feed_rate=Slider(720, range=0..1000),
    extrusion_feed_rate=number_slider_9,
    start_gcode_lines=start_gcode_do_not_edit,
    end_gcode_lines=end_gcode_do_not_edit)  # -> out, gcode_output; inputs lines: list of Line, nozzle_diameter: Double, filament_diameter: Double, layer_height: Double, extrusion_width: Double, travel_feed_rate: Double, layer_change_feed_rate: Double, extrusion_feed_rate: Double, start_gcode_lines: list of String, end_gcode_lines: list of String
# ---------- python_3_script_generate_gcode: Python ----------
"""
    This file contains parameters, helpers, and setup to 
    create a basic gcode generation algorithm from line segments.
    
    The main 
    
    Inputs:
        lines: the line segments to be converted into gcode commands for extrusion 
        nozzle_diameter: the diameter of the 3D printer's nozzle
        filament_diameter: the diameter of the 3d printing filament
        layer_height: the height of each layer in the print
        extrusion_width: the width of the extruded line from the printer
        travel_feed_rate: the speed at which the extruder moves in X and Y
        layer_change_feed_rate: the speed at which teh extruder moves when 
            changing layers in the Z direction
        extrusion_feed_rate: the speed at which the extruder move when extruding

    Output:
        gcode_output: a string with gcode commands separate by new-lines"""

__author__ = "mrivera-cu"

import rhinoscriptsyntax as rs

import math


########## CONSTANTS BELOW ###############

# GCODE COMMANDS
COMMAND_MOVE = "G1"

# GCODE PARAM NAMES
PARAM_X = "X"
PARAM_Y = "Y"
PARAM_Z = "Z"
PARAM_E = "E"
PARAM_F = "F"

# Separates commands
COMMAND_DELIMITER = "\n"

# Precision for converting floats to strings
E_VALUE_PRECISION = 5
XYZ_VALUE_PRECISION = 3

# Float equality precision
FLOAT_EQUALITY_PRECISION = 5

# Converts a float (f) to a string with some precision of decimal places
# For example: 
# Input: f=0.1234, precision=3 
# Output: "0.123"
def float_to_string(f, precision=XYZ_VALUE_PRECISION): 
    f = float(f)
    str_format = "{value:." + str(precision) +"f}"
    return str_format.format(value=f)
    
# Helper to convert the E value to the proper precision
def e_value_to_string(e):
    return float_to_string(e, E_VALUE_PRECISION)

# Helper to convert the XYZ value to the proper precision
def xyz_value_to_string(e):
    return float_to_string(e, XYZ_VALUE_PRECISION)

#########################################################################

# Helper function to compare floats in grasshopper/python due to float precision errors
def are_floats_equal(f1, f2, epsilon=10**(-FLOAT_EQUALITY_PRECISION)):
    f1 *= 10**FLOAT_EQUALITY_PRECISION
    f2 *= 10**FLOAT_EQUALITY_PRECISION
    return math.fabs(f2 - f1) <= epsilon
    
# Helper function to compare if two points are equal (have the same coordinates)
# by handling float precision comparisons
def is_same_pt(ptA, ptB):
    return are_floats_equal(ptA[0], ptB[0]) and are_floats_equal(ptA[1], ptB[1]) and are_floats_equal(ptA[2], ptB[2])
     
     
########################################################################
# creates a string consisting of a G1 move command and 
# any associated parameters
def gcode_move(current_pos, next_pos, feed_rate=None, should_extrude=False):
    # Start with "G1" as command
    move_command_str = COMMAND_MOVE
    
    # Compare X positions
    if (not are_floats_equal(current_pos[0],next_pos[0])):
        # we have a different x position so add it as a parameter to the command
        x_value = float_to_string(next_pos[0], precision=XYZ_VALUE_PRECISION)
        # Add X<x_value> to move string, e.g., X100.00
        move_command_str += " " + PARAM_X + x_value
    
    # Compare Y positions
    if (not are_floats_equal(current_pos[1], next_pos[1])):
        # we have a different y position so add the new position as a parameter
        y_value = float_to_string(next_pos[1], precision=XYZ_VALUE_PRECISION)
        # Add Y<y_value> to move string, e.g., Y100.00
        move_command_str += " " + PARAM_Y + y_value
    
    # Compare Z position
    if (not are_floats_equal(current_pos[2], next_pos[2])):
        # we have a different z position so add the new position as a parameter
        z_value = float_to_string(next_pos[2], precision=XYZ_VALUE_PRECISION)
        # Add Z<z_value> to move string, e.g., Z100.00
        move_command_str += " " + PARAM_Z + z_value
    
    # [TODO]: handle "should_extrude" == true by determining the proper amount to
    # extrude using the capsule model, then append the E parameter and value
    # to the move command.
    # NOTE: YOUR FLOAT PRECISION MUST MATCH E_VALUE_PRECISION
    if should_extrude:
        dx = next_pos[0] - current_pos[0]
        dy = next_pos[1] - current_pos[1]
        dz = next_pos[2] - current_pos[2]
        distance = math.sqrt(dx**2 + dy**2 + dz**2)

        # Rectangular area + two half circles = rectangle + 1 full circle
        rect_area = (extrusion_width - layer_height) * layer_height
        semi_circle_area = math.pi * (layer_height / 2.0) ** 2
        extrusion_area = rect_area + semi_circle_area  # mm²

        # Output volume = cross-sectional area * distance moved
        v_out = extrusion_area * distance  # mm³

        # Filament cross-sectional area (input)
        filament_area = math.pi * (filament_diameter / 2.0) ** 2  # mm²

        # E value = volume of extrusion / filament cross-section area
        e_value = v_out / filament_area  # mm (filament length extruded)

        # Append E value to command
        move_command_str += " " + PARAM_E + e_value_to_string(e_value)
    
    # See if we have a feedrate to use, and handle it differently than other 
    # parameters as it is an integer value
    if (feed_rate is not None):
        # feed rate is an int
        feed_rate_value = round(feed_rate)
        # Add F<feed_rate_value> to move string, e.g., F2000
        move_command_str += " " + PARAM_F + str(feed_rate_value)   
    
    # Remove excess whitespace on ends
    move_command_str = move_command_str.strip(" ")
    return move_command_str



    
''' Here's the main method of the script that uses the helper methods above '''


def generate_gcode():
   

    #Initialize
    current_position = [0.0, 0.0, 0.0]
    all_move_commands = []
    last_layer_z = None

    # Loop over each line segment
    for line in lines:
        start_pt = [line.From.X, line.From.Y, line.From.Z]
        end_pt = [line.To.X, line.To.Y, line.To.Z]

        # Layer change - move Z only if necessary
        if last_layer_z is None or not are_floats_equal(last_layer_z, start_pt[2]):
            z_move_target = [current_position[0], current_position[1], start_pt[2]]
            z_move_command = gcode_move(
                current_pos=current_position,
                next_pos=z_move_target,
                feed_rate=layer_change_feed_rate,
                should_extrude=False
            )
            all_move_commands.append(z_move_command)
            current_position = z_move_target
            last_layer_z = start_pt[2]

        #Travel move to line start
        if not is_same_pt(current_position, start_pt):
            travel_command = gcode_move(
                current_pos=current_position,
                next_pos=start_pt,
                feed_rate=travel_feed_rate,
                should_extrude=False
            )
            all_move_commands.append(travel_command)
            current_position = start_pt

        # Extrude move along the line
        extrude_command = gcode_move(
            current_pos=current_position,
            next_pos=end_pt,
            feed_rate=extrusion_feed_rate,
            should_extrude=True
        )
        all_move_commands.append(extrude_command)
        current_position = end_pt

  
    gcode_lines = start_gcode_lines + all_move_commands + end_gcode_lines

    output = COMMAND_DELIMITER.join(gcode_lines)
    
    return output
    
''' RUN THE MAIN FUNCITON ABOVE - DO NOT EDIT '''
# this sets the gcode commands to be the the gcode_output variable of this grasshopper component
gcode_output = generate_gcode()
# ---------- end python_3_script_generate_gcode ----------
debugging_panel = Panel(python_3_script_generate_gcode.out)
panel_14 = Panel(python_3_script_generate_gcode.gcode_output)
export_txt = ExportTXT(
    Content=panel_14,
    FileLocation=panel_3,
    Overwrite=Toggle(True),
    Encoding="utf-8",
    Export=true_only_button,
    LastSaveLocalization="neutral,N")
panel_15 = Panel(export_txt)

# ---- group: Infill calculation
list_item = ListItem(List=flatten(deconstruct_box_4.X), Index=Slider(1, range=0..1), Wrap=True)
bounds = Bounds(Numbers=list_item)
deconstruct_domain_9 = DeconstructDomain(Domain=bounds)  # -> Start, End
ew = Slider(0.48, range=0..1)
division_5 = Division(A=deconstruct_domain_9.End, B=ew)

# ---- group: concentric
division_6 = Division(A=division_5, B=Slider(2, range=0..10))
series_6 = Series(Start=0, Step=ew, Count=division_6)
offset_on_srf = OffsetOnSrf(Curve=cull_index, Distance=series_6, Surface=cull_index)
trim_tree_4 = TrimTree(Tree=offset_on_srf, Depth=1)
simplify_tree_8 = SimplifyTree(Tree=trim_tree_4, Front=False)

# ---- group: Reconstructing lines
divide_distance_5 = DivideDistance(Curve=simplify_tree_8, Distance=Slider(0.1, range=0..0.1))  # -> Points, Tangents, Parameters
polyline_5 = PolyLine(Vertices=divide_distance_5.Points, Closed=True)
tolerance_3 = Slider(0.01, range=0..0.01)
simplify_curve_5 = SimplifyCurve(Curve=polyline_5, Tolerance=tolerance_3)  # -> Curve, Simplified
panel_16 = Panel(polyline_5)
explode_5 = Explode(Curve=simplify_curve_5.Curve, Recursive=True)  # -> Segments, Vertices

# ---- group: Density
number_slider_11 = Slider(0.1, range=0..0.1)
number_slider_12 = Slider(0.2, range=0..1)
number_slider_13 = Slider(1, range=0..1)
number_slider_14 = Slider(0.5, range=0..1)

# ----
multiplication_4 = Multiplication(A=division_5, B=number_slider_12)

# ---- group: Infill calculation (continued)
infill_calculation = Integer(multiplication_4)

# ---- group: Infill lines
number_slider_15 = Slider(0.48, range=0..1)
number_slider_16 = Slider(0, range=0..1)
line_5 = Line(StartPoint=vector_xyz_4.Vector, EndPoint=vector_xyz_5.Vector)

# ---- group: Density (continued)
division_7 = Division(A=number_slider_15, B=number_slider_12)

# ---- group: Infill lines (continued)
series_7 = Series(Start=division_7, Step=division_7, Count=infill_calculation)
unit_x_3 = UnitX(Factor=series_7)
move_6 = Move(Geometry=line_5, Motion=unit_x_3)  # -> Geometry, Transform

# ----
simplify_tree_9 = SimplifyTree(Tree=move_6.Geometry, Front=False)
panel_17 = Panel(simplify_tree_9)

# ---- group: Infill lines (continued)
brep_line = BrepLine(Brep=simplify_tree_4, Line=simplify_tree_9, LimitToFirst=False, UseTasks=True)  # -> Curves, Points

# ----
panel_18 = Panel(brep_line.Curves)

# ---- group: Optimized infill path
simplify_tree_10 = SimplifyTree(Tree=brep_line.Curves, Front=False)
path_mapper_2 = PathMapper(simplify_tree_10, source="{A;B}", target="{A}")
list_length = ListLength(List=path_mapper_2)
series_8 = Series(Start=0, Step=1, Count=list_length)
expression_6 = Expression(x=series_8, Expression="x % 2 = 0")
dispatch_2 = Dispatch(List=path_mapper_2, DispatchPattern=expression_6)  # -> ListA, ListB
curve_2 = Curve(dispatch_2.ListA)
panel_19 = Panel(curve_2)
curve_3 = Curve(dispatch_2.ListB)
panel_20 = Panel(curve_3)
flip_curve = FlipCurve(Curve=curve_3)  # -> Curve, Flag
end_points = EndPoints(Curve=flip_curve.Curve)  # -> Start, End
end_points_2 = EndPoints(Curve=curve_2)  # -> Start, End
point_3 = Point(end_points.Start)
point_4 = Point(end_points.End)
point_5 = Point(end_points_2.Start)
point_6 = Point(end_points_2.End)
shift_list = ShiftList(List=point_6, Shift=1, Wrap=False)
list_length_2 = ListLength(List=point_6)
expression_7 = Expression(x=list_length_2, Expression="X-1")
cull_index_2 = CullIndex(List=point_3, Indices=expression_7, Wrap=True)
line_6 = Line(StartPoint=point_5, EndPoint=point_4)
line_7 = Line(StartPoint=cull_index_2, EndPoint=shift_list)
simplify_tree_11 = SimplifyTree(Tree=cull_index, Front=False)  # -> graft(Tree)
simplify_tree_12 = SimplifyTree(Tree=line_6, Front=False)
simplify_tree_13 = SimplifyTree(Tree=line_7, Front=False)
graft_tree_2 = GraftTree(Tree=simplify_tree_13, IncludeEmptyLists=True, IncludeNullItems=True)
graft_tree_3 = GraftTree(Tree=simplify_tree_12, IncludeEmptyLists=True, IncludeNullItems=True)
merge_4 = Merge(Data1=graft_tree_3, Data2=graft_tree_2, Data3=simplify_tree_10, Data4=simplify_tree_11)
trim_tree_5 = TrimTree(Tree=merge_4, Depth=1)
panel_21 = Panel(trim_tree_5)

# ---- group: Reconstructing lines
divide_distance_6 = DivideDistance(Curve=trim_tree_5, Distance=Slider(0.1, range=0..0.1))  # -> Points, Tangents, Parameters
polyline_6 = PolyLine(Vertices=divide_distance_6.Points, Closed=True)
tolerance_4 = Slider(0.01, range=0..0.01)
simplify_curve_6 = SimplifyCurve(Curve=polyline_6, Tolerance=tolerance_4)  # -> Curve, Simplified
panel_22 = Panel(polyline_6)
explode_6 = Explode(Curve=simplify_curve_6.Curve, Recursive=True)  # -> Segments, Vertices
