# Grasshopper definition FRzz.gh (Grasshopper 1.0.8)
# plug-ins: Pufferfish, Kangaroo2 Components

# ---- group: Generating base curve
X = Curve(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)
u = Curve(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)
divide_curve = DivideCurve(Curve=u, Count=Slider(100, range=0..100), Kinks=False)  # -> Points, Tangents, Parameters
divide_curve_2 = DivideCurve(Curve=u, Count=Slider(100, range=0..100), Kinks=False)  # -> Points, Tangents, Parameters
surface = Surface(u)
polyline = PolyLine(Vertices=divide_curve.Points, Closed=False)
shift_list = ShiftList(List=divide_curve_2.Points, Shift=1, Wrap=True)
line = Line(StartPoint=divide_curve_2.Points, EndPoint=shift_list)
explode = Explode(Curve=polyline, Recursive=True)  # -> Segments, Vertices
line_2 = Line(explode.Segments)
mesh_brep = MeshBrep(
    Brep=surface,
    Settings={GridMaxCount=0, GridMinCount=16, JaggedSeams=False, MaxEdgeLength=0, MinEdgeLength=0.0001, MinTolerance=0, Refine=True, RefineAngle=0, RelativeTolerance=0.65, SimplePlanes=True, Tolerance=0})
strengtsh = Slider(1000, range=0..1000)
strength = Slider(51, range=0..100)
length = Slider(6.03, range=0..10)
radius = Slider(2.5, range=0..10)
onmesh = OnMesh(Points=divide_curve_2.Points, Mesh=mesh_brep, Strength=strengtsh)
shift_list_2 = ShiftList(List=line, Shift=1, Wrap=True)
length_line = LengthLine(Line=line, Length=length, Strength=10)
collider = Collider(Objects=[line, line_2], Radii=radius, Strength=strength)
strength_2 = Slider(375, range=0..1000)
angle = Slider(6, range=0..10)
angle_2 = Angle(LineA=line, LineB=shift_list_2, RestAngle=angle, Strength=strength_2)
damp = Slider(0.554, range=0..1)
bouncysolver = BouncySolver(
    GoalObjects=flatten([onmesh, length_line, collider, angle_2]),
    Reset=Button(),
    Threshold=1e-15,
    Tolerance=0.0001,
    Damping=damp,
    Iterations=10,
    On=Toggle(True))  # -> I, V, O
degree = Slider(10, range=0..10)
nurbs_curve = NurbsCurve(Vertices=bouncysolver.V, Degree=degree, Periodic=True)  # -> Curve, Length, Domain

# ----
xoutcome1 = Curve(<curve referenced from the Rhino model>)
u_outcome1 = Curve(<curve referenced from the Rhino model>)

# ---- group: generating base shape
series = Series(Start=0, Step=Slider(1.5, range=0..10), Count=Slider(20, range=0..100))
unit_z = UnitZ(Factor=series)
move = Move(Motion=unit_z)  # -> Geometry, Transform
list_length = ListLength(List=move.Geometry)
list_length_2 = ListLength(List=move.Geometry)
subtraction = Subtraction(A=list_length_2, B=Slider(1, range=0..1))
subtraction_2 = Subtraction(A=list_length, B=Slider(1, range=0..1))
area = Area(Geometry=move.Geometry)  # -> Area, Centroid
range = Range(Domain=Domain(0, 1), Steps=subtraction)
graph_mapper = GraphMapper(
    range,
    x0=0,
    x1=1,
    y0=0,
    y1=1,
    container_name="Bezier",
    cpx=[0, 0.4572258294, 0.6498821378, 1],
    cpy=[0.3659946918, 0.1949151754, 0.1752610803, 0.8569180369])
range_2 = Range(Domain=Domain(0, 1), Steps=subtraction_2)
graph_mapper_2 = GraphMapper(
    range_2,
    x0=0,
    x1=1,
    y0=0,
    y1=1,
    container_name="Bezier",
    cpx=[0, 0.006551106926, 1, 1],
    cpy=[0.6277642846, 0.24841398, 0.09172612429, 1])
construct_domain = ConstructDomain(DomainStart=Slider(0.3, range=0..1), DomainEnd=Slider(1.05, range=0..10))
remap_numbers = RemapNumbers(Value=graph_mapper, Source=Domain(0, 1), Target=construct_domain)  # -> Mapped, Clipped
construct_domain_2 = ConstructDomain(DomainStart=0, DomainEnd=Slider(60, range=0..100))
remap_numbers_2 = RemapNumbers(Value=graph_mapper_2, Source=Domain(0, 1), Target=construct_domain_2)  # -> Mapped, Clipped
rotate = Rotate(Geometry=move.Geometry, Angle=degrees(remap_numbers_2.Mapped), Plane=area.Centroid)  # -> Geometry, Transform
area_2 = Area(Geometry=rotate.Geometry)  # -> Area, Centroid
scale = Scale(Geometry=rotate.Geometry, Center=area_2.Centroid, Factor=remap_numbers.Mapped)  # -> Geometry, Transform

# ----
loft = Loft(Curves=scale.Geometry, Options={Adjust=False, Closed=False, LoftEnds=0, LoftSimp=0, LoftType=0, Rebuild=10, Refit=0.01})

# ---- group: Design draft
curve = Curve(<curve referenced from the Rhino model>)
curve_2 = Curve(<curve referenced from the Rhino model>)
selecting_the_top_curve = Slider(19, range=0..100)
bounding_box = BoundingBox(Content=loft, Plane=PlaneXY(0, 0, 0))  # -> Box, Box_2
list_item = ListItem(List=scale.Geometry, Index=selecting_the_top_curve, Wrap=True)
deconstruct_box = DeconstructBox(Box=bounding_box.Box)  # -> Plane, X, Y, Z
area_3 = Area(Geometry=list_item)  # -> Area, Centroid
surface_2 = Surface(curve)
deconstruct_domain = DeconstructDomain(Domain=deconstruct_box.Z)  # -> Start, End
conection_height = Slider(4, range=0..10)
addition = Addition(A=deconstruct_domain.End, B=conection_height)
unit_z_2 = UnitZ(Factor=addition)
matching_rotation = Slider(22, range=0..100)
move_2 = Move(Geometry=surface_2, Motion=unit_z_2)  # -> Geometry, Transform
list_item_2 = ListItem(List=remap_numbers_2.Mapped, Index=matching_rotation, Wrap=True)
rotate_2 = Rotate(Geometry=move_2.Geometry, Angle=list_item_2, Plane=area_3.Centroid)  # -> Geometry, Transform
area_4 = Area(Geometry=rotate_2.Geometry)  # -> Area, Centroid
scale_2 = Scale(Geometry=rotate_2.Geometry, Center=area_4.Centroid, Factor=Slider(1.4, range=0..10))  # -> Geometry, Transform
loft_2 = Loft(
    Curves=flatten([list_item, scale_2.Geometry]),
    Options={Adjust=False, Closed=False, LoftEnds=0, LoftSimp=0, LoftType=0, Rebuild=10, Refit=0.01})
creating_thickness = Slider(3, range=0..10)
offset_surface = OffsetSurface(Surface=scale_2.Geometry, Distance=creating_thickness, BothSides=0, CreateSolid=True)
solid_union = SolidUnion(Breps=[loft, loft_2, offset_surface])
cap_holes = CapHoles(Brep=solid_union)

# ---- group: Design1-X
mesh_brep_2 = MeshBrep(
    Brep=loft,
    Settings={GridMaxCount=0, GridMinCount=16, JaggedSeams=False, MaxEdgeLength=0, MinEdgeLength=0.0001, MinTolerance=0, Refine=True, RefineAngle=0, RelativeTolerance=0.65, SimplePlanes=True, Tolerance=0})
offset_mesh = OffsetMesh(Mesh=mesh_brep_2, Distance=Slider(1.5, range=0..10), BothSides=0, CreateSolid=True)

# ---- group: Design2-U
cap_holes_2 = CapHoles(Brep=loft)
contour = Contour(Shape=cap_holes_2, Point=Point(0, 0, 0), Direction=Vector(0, 0, 1), Distance=Slider(2, range=0..10))
surface_3 = Surface(contour)
unit_z_3 = UnitZ(Factor=Slider(3, range=0..10))
extrude = Extrude(Base=surface_3, Direction=unit_z_3)
solid_union_2 = SolidUnion(Breps=flatten(extrude))
