# Grasshopper definition extra.gh (Grasshopper 1.0.8)
# plug-ins: PTComponentLibrary

unit_z = UnitZ(Factor=Slider(40, range=0..100))

# ---- group: form design
number_slider = Slider(0, range=0..100)
vector_xyz = VectorXYZ(XComponent=number_slider, YComponent=number_slider, ZComponent=number_slider)  # -> Vector, Length
xy_plane = XYPlane(Origin=vector_xyz.Vector)
polygon = Polygon(Plane=xy_plane, Radius=Slider(8, range=0..100), Segments=6, FilletRadius=0)  # -> Polygon, Length
area = Area(Geometry=polygon.Polygon)  # -> Area, Centroid
ellipse = Ellipse(Plane=xy_plane, Radius1=Slider(20, range=0..100), Radius2=Slider(10, range=0..100))  # -> Ellipse, Focus1, Focus2
move = Move(Geometry=ellipse.Ellipse, Motion=unit_z)  # -> Geometry, Transform
area_2 = Area(Geometry=move.Geometry)  # -> Area, Centroid
loft = Loft(
    Curves=[move.Geometry, polygon.Polygon],
    Options={Adjust=False, Closed=False, LoftEnds=0, LoftSimp=0, LoftType=0, Rebuild=10, Refit=0.01})
line = Line(StartPoint=area_2.Centroid, EndPoint=area.Centroid)
twist = Twist(Geometry=loft, Axis=line, Angle=1.570796327, Infinite=False, Rigid=False)
cap_holes = CapHoles(Brep=twist)

# ---- group: failed
bounding_box = BoundingBox(Content=cap_holes, Plane=PlaneXY(0, 0, 0))  # -> Box, Box_2
deconstruct_box = DeconstructBox(Box=bounding_box.Box)  # -> Plane, X, Y, Z
unit_x = UnitX(Factor=1)
bounds = Bounds(Numbers=deconstruct_box.Z)
number_slider_2 = Slider(2, range=0..10)
contour = Contour(Shape=cap_holes, Point=Point(0, 0, 0), Direction=unit_x, Distance=number_slider_2)  # -> reparameterize(Contours)
deconstruct_domain = DeconstructDomain(Domain=bounds)  # -> Start, End
deconstruct_domain_2 = DeconstructDomain(Domain=deconstruct_box.Z)  # -> Start, End
number_slider_3 = Slider(1, range=0..1)
division = Division(A=deconstruct_domain.End, B=number_slider_2)
flip_curve = FlipCurve(Curve=contour)  # -> Curve, Flag
series = Series(Start=0, Step=number_slider_2, Count=division)
xy_plane_2 = XYPlane(Origin=Point(0, 0, 0))
panel = Panel(division)
rectangle = Rectangle(Plane=PlaneXY(0, 0, 0), XSize=Domain(-1, 1), YSize=Domain(-2, 2), Radius=0)  # -> Rectangle, Length
unit_z_2 = UnitZ(Factor=series)
unit_z_3 = UnitZ(Factor=deconstruct_domain_2.Start)
plane_surface = PlaneSurface(Plane=PlaneXY(0, 0, 0), XSize=Domain(-10, 10), YSize=Domain(-10, 10))
number_slider_4 = Slider(1, range=0..1)
unit_y = UnitY(Factor=1)
move_2 = Move(Geometry=plane_surface, Motion=unit_z_3)  # -> Geometry, Transform
move_3 = Move(Geometry=move_2.Geometry, Motion=unit_z_2)  # -> Geometry, Transform
brep_plane = BrepPlane(Brep=cap_holes, Plane=move_3.Geometry)  # -> Curves, Points
intersect_curves = IntersectCurves(CU=flatten(contour), CV=flatten(brep_plane.Curves))
point = Point(intersect_curves)
plane_origin = PlaneOrigin(Base=xy_plane_2, Origin=point)
perp_frame = PerpFrame(Curve=reparameterize(brep_plane.Curves), Parameter=Slider(0.5, range=0..1))
unit_x_2 = UnitX(Factor=expr("-x", 1))
move_4 = Move(Geometry=plane_origin, Motion=unit_x_2)  # -> Geometry, Transform
boundary_surfaces = BoundarySurfaces(Edges=brep_plane.Curves)
region_difference = RegionDifference()
rectangle_2 = Rectangle(Plane=move_4.Geometry, XSize=Slider(1, range=0..1), YSize=Slider(5, range=0..10), Radius=0)  # -> Rectangle, Length
offset_curve = OffsetCurve(Curve=brep_plane.Curves, Distance=Slider(1, range=0..1), Corners=1)
graft_tree = GraftTree(Tree=rectangle_2.Rectangle, IncludeEmptyLists=True, IncludeNullItems=True)
region_difference_2 = RegionDifference(CurvesA=graft_tree, CurvesB=offset_curve)

# ---- group: Other direction slicer
unit_z_4 = UnitZ(Factor=Slider(60, range=0..100))
move_5 = Move(Geometry=cap_holes, Motion=unit_z_4)  # -> Geometry, Transform
number_slider_5 = Slider(1, range=0..1)
deconstruct_brep = DeconstructBrep(Brep=move_5.Geometry)  # -> Faces, Edges, Vertices
list_item = ListItem(List=deconstruct_brep.Vertices, Index=0, Wrap=True)
vector_xyz_2 = VectorXYZ(XComponent=number_slider_5, YComponent=number_slider_5, ZComponent=number_slider_5)  # -> Vector, Length
contour_2 = Contour(Shape=move_5.Geometry, Point=list_item, Direction=vector_xyz_2.Vector, Distance=Slider(5, range=0..10))

# ---- group: Basic cutting
deconstruct_brep_2 = DeconstructBrep(Brep=cap_holes)  # -> Faces, Edges, Vertices
list_item_2 = ListItem(List=deconstruct_brep_2.Vertices, Index=0, Wrap=True)
number_slider_6 = Slider(5, range=0..10)
unit_z_5 = UnitZ(Factor=1)
contour_3 = Contour(Shape=cap_holes, Point=list_item_2, Direction=unit_z_5, Distance=expr("x-0.1", number_slider_6))  # -> flatten(Contours)
unit_x_3 = UnitX(Factor=1)
contour_4 = Contour(Shape=cap_holes, Point=list_item_2, Direction=unit_x_3, Distance=expr("x-0.1", number_slider_6))
deleting_the_top_layer = Slider(8, range=0..10)
cull_index = CullIndex(List=contour_3, Indices=deleting_the_top_layer, Wrap=True)
material_thickness = Slider(2, range=0..10)
unit_x_4 = UnitX(Factor=expr("-x/2", material_thickness))
move_6 = Move(Geometry=contour_4, Motion=unit_x_4)  # -> Geometry, Transform
_1_2_thickness = Slider(1, range=0..1)
unit_z_6 = UnitZ(Factor=_1_2_thickness)
move_7 = Move(Geometry=cull_index, Motion=unit_z_6)  # -> Geometry, Transform
surface = Surface(move_6.Geometry)
surface_2 = Surface(move_7.Geometry)
unit_x_5 = UnitX(Factor=Slider(2, range=0..10))
extrude = Extrude(Base=surface, Direction=unit_x_5)
unit_z_7 = UnitZ(Factor=Slider(2, range=0..10))
extrude_2 = Extrude(Base=surface_2, Direction=unit_z_7)

# ---- group: cutting slots
brep_brep = BrepBrep(BrepA=extrude_2, BrepB=extrude)  # -> Curves, Points
bounding_box_2 = BoundingBox(Content=brep_brep.Curves, Plane=PlaneXY(0, 0, 0), UnionBox=True)  # -> Box, Box_2
getting_the_edges = Slider(5, range=0..10)
deconstruct_brep_3 = DeconstructBrep(Brep=bounding_box_2.Box)  # -> Faces, Edges, Vertices
list_item_3 = ListItem(List=deconstruct_brep_3.Edges, Index=getting_the_edges, Wrap=True)
calculaiting_gaps = UnitY(Factor=expr("x/2", list_item_3))
unit_y_2 = UnitY(Factor=expr("-x/2", list_item_3))
number_slider_7 = Slider(2, range=0..10)
move_8 = Move(Geometry=bounding_box_2.Box, Motion=calculaiting_gaps)  # -> Geometry, Transform
move_9 = Move(Geometry=bounding_box_2.Box, Motion=unit_y_2)  # -> Geometry, Transform
solid_difference = SolidDifference(BrepsA=flatten(extrude), BrepsB=flatten(move_8.Geometry))
solid_difference_2 = SolidDifference(BrepsA=flatten(extrude_2), BrepsB=flatten(move_9.Geometry))

# ---- group: attemptation on export edges
brep = Brep(solid_difference)
graft_tree_2 = GraftTree(Tree=brep, IncludeEmptyLists=True, IncludeNullItems=True)
deconstruct_brep_4 = DeconstructBrep(Brep=solid_difference_2)  # -> Faces, Edges, Vertices
deconstruct_brep_5 = DeconstructBrep(Brep=graft_tree_2)  # -> Faces, Edges, Vertices
list_item_4 = ListItem(List=deconstruct_brep_4.Faces, Index=0, Wrap=True)
list_item_5 = ListItem(List=deconstruct_brep_5.Faces, Index=Slider(10, range=0..10), Wrap=True)
curve = Curve(list_item_4)
curve_2 = Curve(list_item_5)

# ---- group: orient
number_slider_8 = Slider(70, range=0..100)
number_slider_9 = Slider(5, range=0..10)
rectangle_3 = Rectangle(Plane=PlaneXY(0, 0, 0), XSize=number_slider_8, YSize=number_slider_8, Radius=0)  # -> Rectangle, Length
rectangular_array = RectangularArray(Geometry=rectangle_3.Rectangle, Cell=rectangle_3.Rectangle, XCount=number_slider_9, YCount=number_slider_9)  # -> Geometry, Transform
area_3 = Area(Geometry=rectangular_array.Geometry)  # -> Area, Centroid
orient = Orient(Source=PlaneXY(0, 0, 0), Target=area_3.Centroid)  # -> Geometry, Transform
