# Grasshopper definition orgatypo2.gh (Grasshopper 1.0.8)

number_slider = Slider(1, range=0..1)
vector_xyz = VectorXYZ(XComponent=number_slider, YComponent=number_slider, ZComponent=number_slider)  # -> Vector, Length
xy_plane = XYPlane(Origin=vector_xyz.Vector)

# ---- group: Design
baseu = Curve(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)
basex = Curve(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)
random = Random(Range="15 to 30", Number=1, Seed=2)
boundary_surfaces = BoundarySurfaces(Edges=basex)
number_slider_2 = Slider(180, range=0..1000)
unit_z = UnitZ(Factor=random)
domain_box = DomainBox(Base=PlaneXY(0, 0, 0), X=Slider(40, range=0..100), Y=Slider(40, range=0..100), Z=Slider(40, range=0..100))
extrude = Extrude(Base=boundary_surfaces, Direction=unit_z)
random_2 = Random(Range="0.8 to 1.2", Number=number_slider_2, Seed=2)
area = Area(Geometry=extrude)  # -> Area, Centroid
random_3 = Random(Range="0 to 360", Number=number_slider_2, Seed=Slider(4, range=0..10))
populate_3d = Populate3D(Region=domain_box, Count=Slider(180, range=0..1000), Seed=Slider(10, range=0..10))
cap_holes = CapHoles(Brep=extrude)
scale = Scale(Geometry=cap_holes, Center=area.Centroid, Factor=random_2)  # -> Geometry, Transform
rotate_3d = Rotate3D(Geometry=scale.Geometry, Angle=random_3, Center=area.Centroid, Axis=Vector(0, 0, 1))  # -> Geometry, Transform
move = Move(Geometry=rotate_3d.Geometry, Motion=populate_3d)  # -> Geometry, Transform
solid_union = SolidUnion(Breps=move.Geometry)

# ----
vector_xyz_2 = VectorXYZ(XComponent=Slider(500, range=0..1000), YComponent=0, ZComponent=0)  # -> Vector, Length
number_slider_3 = Slider(80, range=0..1000)
xy_plane_2 = XYPlane(Origin=vector_xyz_2.Vector)
wilder_text = Slider(3, range=0..10)

# ---- group: Orienting cutting outlines
brep = Brep(solid_union)
rectangle = Rectangle(Plane=xy_plane_2, XSize=number_slider_3, YSize=number_slider_3, Radius=0)  # -> Rectangle, Length
orient_grids = RectangularArray(Geometry=rectangle.Rectangle, Cell=rectangle.Rectangle, XCount=Slider(4, range=0..10), YCount=Slider(4, range=0..10))  # -> Geometry, Transform
area_2 = Area(Geometry=orient_grids.Geometry)  # -> Area, Centroid

# ---- group: Calculation for the cutting planes
bounding_box = BoundingBox(Content=brep, Plane=PlaneXY(0, 0, 0))  # -> Box, Box_2
material_thickness = Slider(4.5, range=0..10)
deconstruct_box = DeconstructBox(Box=bounding_box.Box)  # -> Plane, X, Y, Z
bounds = Bounds(Numbers=deconstruct_box.Z)
deconstruct_domain = DeconstructDomain(Domain=bounds)  # -> Start, End
deconstruct_domain_2 = DeconstructDomain(Domain=deconstruct_box.Z)  # -> Start, End
division = Division(A=deconstruct_domain.End, B=material_thickness)
integer = Integer(division)
panel = Panel(integer)
unit_z_2 = UnitZ(Factor=deconstruct_domain_2.Start)
series = Series(Start=0, Step=material_thickness, Count=integer)
unit_z_3 = UnitZ(Factor=series)
surface = Surface(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)
move_2 = Move(Geometry=surface, Motion=unit_z_2)  # -> Geometry, Transform
move_3 = Move(Geometry=move_2.Geometry, Motion=unit_z_3)  # -> Geometry, Transform

# ----
brep_plane = BrepPlane(Brep=brep, Plane=move_3.Geometry)  # -> Curves, Points

# ---- group: calculation for only the outter lines
panel_2 = Panel(brep_plane.Curves)
length = Length(Curve=brep_plane.Curves)
panel_3 = Panel(length)
sort_list = SortList(Keys=length, ValuesValuesA=brep_plane.Curves)  # -> Keys, ValuesValuesA
bounds_2 = Bounds(Numbers=length)
sort_list_2 = SortList(Keys=sort_list.Keys, ValuesValuesA=sort_list.ValuesValuesA)  # -> Keys, ValuesValuesA
panel_4 = Panel(bounds_2)
deconstruct_domain_3 = DeconstructDomain(Domain=bounds_2)  # -> Start, End
panel_5 = Panel(sort_list_2.Keys)
flatten_tree = FlattenTree(Tree=length, Path="{0}")
maximum = Maximum(A=deconstruct_domain_3.Start, B=deconstruct_domain_3.End)
panel_6 = Panel(maximum)
member_index = MemberIndex(Set=flatten_tree, Member=maximum)  # -> Index, Count

# ----
flatten_tree_2 = FlattenTree(Tree=brep_plane.Curves, Path="{0}")
selecting_outlines = ListItem(List=flatten_tree_2, Index=member_index.Index, Wrap=True)

# ---- group: Orienting cutting outlines (continued)
move_to_plane = MoveToPlane(Geometry=selecting_outlines, Plane=PlaneXY(0, 0, 0), Above=True, Below=True)  # -> flatten(Geometry), Transform
area_3 = Area(Geometry=move_to_plane.Geometry)  # -> Area, Centroid
orient = Orient(Geometry=move_to_plane.Geometry, Source=area_3.Centroid, Target=area_2.Centroid)  # -> Geometry, Transform

# ---- group: text on surfae
area_4 = Area(Geometry=orient.Geometry)  # -> Area, Centroid
unit_x = UnitX(Factor=wilder_text)
move_4 = Move(Geometry=area_4.Centroid, Motion=unit_x)  # -> Geometry, Transform
planes_count = Number(panel)
surface_grids = Surface(orient.Geometry)
line = Line(StartPoint=move_4.Geometry, EndPoint=area_4.Centroid)
series_2 = Series(Start=Slider(1, range=0..1), Step=1, Count=planes_count)
text_on_surface = TextOnSurface(Text=series_2, Font="Sans Bold:no Italic:no", Height=1, Depth=0.4, BaseLine=line, BaseSurface=surface_grids)
